% Simulink data dictionary TEST_IPM_LIB.sldd

PWM_TPBRD_HALF = Simulink.Parameter(5000, DataType="uint16")
PWM_TPBRD = Simulink.Parameter(10000, DataType="uint16")
Ts_10kHz = Simulink.Parameter(0.0001, DataType="single")
Ts_1kHz = Simulink.Parameter(0.001, DataType="single")
Ts_50Hz = Simulink.Parameter(0.02, DataType="single")
MParamIbase = Simulink.Parameter(360, DataType="single")
PWM_TDEAD = Simulink.Parameter(300, DataType="uint16")
MParamFbase = Simulink.Parameter(200, DataType="single")
Sig = Simulink.Signal()
Configuration_CPU2 = Simulink.ConfigSet(StartTime="0", StopTime="10", Solver="FixedStepAuto", ProdHWDeviceType="Texas Instruments->C2000", SystemTargetFile="ert.tlc", HardwareBoard="TI Delfino F2837xD", TargetLang="C")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
Configuration = Simulink.ConfigSet(StartTime="0", StopTime="0.1", Solver="FixedStepAuto", ProdHWDeviceType="Texas Instruments->C2000", SystemTargetFile="ert.tlc", HardwareBoard="TI Delfino F2837xD", TargetLang="C")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
MParamLq = Simulink.Parameter(0.002, DataType="single")
MParamLd = Simulink.Parameter(0.002, DataType="single")
MParamRs = Simulink.Parameter(1.15, DataType="single")
MParamP = Simulink.Parameter(5, DataType="single")